# Grasshopper definition Franka_ROS_Pick_N_Place_Reaction.gh (Grasshopper 1.0.7)
# plug-ins: Robots

num = Number(0)
num_2 = Number(1)
num_3 = Number(0)
num_4 = Number(1)
num_5 = Number(0)
num_6 = Number(0)
num_7 = Number(500)
num_8 = Number(8)
num_9 = Number(550)
pt = ConstructPoint(XCoordinate=num_9, YCoordinate=num_8, ZCoordinate=num_7)
ros = ROSConnect(ip="192.168.100.170", port="9090", connect=Toggle(True))  # -> ros_client, is_connected; inputs port: Int32, connect: Boolean
#   port ip: The ip address ROS. Defaults to 127.0.0.1.
#   port port: The port of ROS. Defaults to 9090.
#   port connect: If True, connects to ROS. If False, disconnects from ROS. Defaults to False.
#   port ros_client: The ROS client.
#   port is_connected: True if connection established.
# ---------- ros: Python ----------
"""
Connect or disconnect to ROS.

COMPAS FAB v0.28.0
"""
from ghpythonlib.componentbase import executingcomponent as component
from scriptcontext import sticky as st

from compas_fab.backends import RosClient
from compas_fab.ghpython.components import create_id


class ROSConnect(component):
    def RunScript(self, ip, port, connect):
        ros_client = None

        ip = ip or "127.0.0.1"
        port = port or 9090

        key = create_id(self, "ros_client")
        ros_client = st.get(key, None)

        if ros_client:
            st[key].close()
        if connect:
            st[key] = RosClient(ip, port)
            st[key].run(5)

        ros_client = st.get(key, None)
        is_connected = ros_client.is_connected if ros_client else False
        return (ros_client, is_connected)
# ---------- end ros ----------

# ----
# Subscribe the robot state
panel = Panel("100")
subscribe = SubscribeToTopic(
    ros_client=ros.ros_client,
    topic_name="/robot/state",
    topic_type="franka_compas_interface/FrankaState",
    interval=panel,
    start=Button(),
    stop=Button())  # -> topic, last_msg, is_subscribed; inputs interval: Int32, start: Boolean, stop: Boolean
#   port ros_client: The ROS client.
#   port topic_name: Name of the topic to subscribe to, eg. /joint_states
#   port topic_type: Type of the topic to subscribe to, eg. sensor_msgs/JointState
#   port interval: Interval in milliseconds at which to expire the solution to propagate received messages. Defaults to 25ms. Messages are not queued, so if the interval is greater than the rate at which messages are published, some messages will be dropped.
#   port start: Start receiving messages.
#   port stop: Stop receiving messages.
#   port topic: The subscribed topic instance.
#   port last_msg: The last received message.
#   port is_subscribed: Indicates if the topic is currently subscribed or not.
# ---------- subscribe: Python ----------
"""
Subscribe to a ROS topic.

COMPAS FAB v0.28.0
"""
import time

import Grasshopper.Kernel
from ghpythonlib.componentbase import executingcomponent as component
from roslibpy import Topic
from scriptcontext import sticky as st

from compas_fab.backends.ros.messages import ROSmsg
from compas_fab.ghpython.components import create_id


class ROSTopicSubscribe(component):
    def RunScript(self, ros_client, topic_name, topic_type, interval, start, stop):
        if not topic_name:
            raise ValueError("Please specify the name of the topic")
        if not topic_type:
            raise ValueError("Please specify the type of the topic")

        if not hasattr(self, "message_count"):
            self.message_count = 0

        self.interval = interval or 25  # in milliseconds
        self.is_updating = False
        self.is_subscribed = False

        self.msg_key = create_id(self, "last_msg")
        key = create_id(self, "topic")

        last_msg = st.get(self.msg_key, None)
        topic = st.get(key, None)

        if ros_client and ros_client.is_connected:
            if start:
                self._unsubscribe(topic)

                topic = Topic(ros_client, topic_name, topic_type)
                topic.subscribe(self.topic_callback)
                time.sleep(0.2)

                st[key] = topic

            if stop:
                self._unsubscribe(topic)

        self.is_subscribed = topic and topic.is_subscribed

        if last_msg:
            last_msg = ROSmsg.parse(last_msg, topic_type)

        if self.is_subscribed:
            self.Message = "Subscribed, {} messages".format(self.message_count)
        else:
            self.Message = "Not subscribed"

        return (topic, last_msg, self.is_subscribed)

    def _unsubscribe(self, topic):
        if topic and topic.is_subscribed:
            topic.unsubscribe()
            time.sleep(0.2)

    def topic_callback(self, msg):
        self.message_count += 1
        st[self.msg_key] = msg

        if self.is_subscribed:
            ghdoc = ghenv.Component.OnPingDocument()  # noqa: F821 This is defined by Grasshopper
            if not self.is_updating and ghdoc.SolutionState != Grasshopper.Kernel.GH_ProcessStep.Process:
                self.is_updating = True
                ghdoc.ScheduleSolution(
                    self.interval, Grasshopper.Kernel.GH_Document.GH_ScheduleDelegate(self.expire_callback)
                )

    def expire_callback(self, ghdoc):
        if ghdoc.SolutionState != Grasshopper.Kernel.GH_ProcessStep.Process:
            ghenv.Component.ExpireSolution(False)  # noqa: F821 This is defined by Grasshopper
        self.is_updating = False
# ---------- end subscribe ----------
panel_2 = Panel(subscribe.is_subscribed)

vec = VectorXYZ(XComponent=num_2, YComponent=num, ZComponent=num_3)  # -> Vector, Length
vec_2 = VectorXYZ(XComponent=num_5, YComponent=num_4, ZComponent=num_6)  # -> Vector, Length
pl = ConstructPlane(Origin=pt, XAxis=vec.Vector, YAxis=vec_2.Vector)
python = GhPythonScript()  # -> plane
# ---------- python: Python ----------
import rhinoscriptsyntax as rs
plane = rs.CreatePlane([550,8,250],[1,0,0],[0,1,0])
# ---------- end python ----------
panel_3 = Panel(ros.is_connected)
python_2 = GhPythonScript(ros_client=ros.ros_client, start_plane=pl, dst_plane=python, execute_motion=Button())  # -> result
# ---------- python_2: Python ----------
import rhinoscriptsyntax as rs
from compas.geometry import Point
from compas.geometry import Vector
from compas.geometry import Frame
from compas.geometry import Rotation
import math
import time
import roslibpy
from roslibpy import Service

J6_OFFSET = -math.pi/4 #panda hand

print(start_plane)
print(dst_plane)

def apply_panda_hand_offset(plane):
    f_original = Frame(plane.Origin,plane.XAxis,plane.YAxis)
    f_tmp = Frame([0,0,0],[1,0,0],[0,1,0])
    
    R =Rotation.from_axis_angle_vector(f_original.axis_angle_vector)
    r_j6_offset = Rotation.from_axis_and_angle([0,0,1],J6_OFFSET)
    
    f_tmp = f_tmp.transformed(R*r_j6_offset)
    
    return Frame(f_original.point,f_tmp.xaxis,f_tmp.yaxis)


def frame_to_move_linear_msg(f):
    rx,ry,rz = f.euler_angles(static=False,axes='xyz')
    x,y,z = f.point    
    return dict(x=x/1000,y=y/1000,z=z/1000,rx=rx,ry=ry,rz=rz,speed=0.1)
    
    

start_frame_aligned = apply_panda_hand_offset(start_plane) 
dst_frame_aligned = apply_panda_hand_offset(dst_plane)

#Visualize output for debug
#start_plane_aligned = rs.CreatePlane(start_frame_aligned.point,start_frame_aligned.xaxis[:],start_frame_aligned.yaxis[:])
#dst_plane_aligned = rs.CreatePlane(dst_frame_aligned.point,dst_frame_aligned.xaxis[:],dst_frame_aligned.yaxis[:])



if execute_motion:    
    a = ros_client.get_service_type("/move_linear") 
    service = roslibpy.Service(ros_client, '/robot/move_linear', 'franka_compas_interface/MoveLinear')
    request = roslibpy.ServiceRequest(frame_to_move_linear_msg(start_frame_aligned))
    print('Calling service...')
    result = service.call(request)
    print('Service response: {}'.format(result))

    a = result['success']
    
    result = True
# ---------- end python_2 ----------

# ----
# Reaction Example:
# Move the robot from start_plane to target_plane;
# If the robot detects the force_z > max_force, it trigger a motion defined by reaction_vector.
# Noted that the reaction_vector are defined in M and Rad w.r.t. the target_plane.
# For example, if you want the robot move 100 mm upwards, it is [0,0,100,0,0,0]
num_10 = Number(Slider(0, range=-3.1415..3.1415))  # disabled
num_11 = Number(Slider(0, range=0..100))  # disabled
num_12 = Number(Slider(0, range=0..100))  # disabled
num_13 = Number(Slider(0, range=-3.1415..3.1415))  # disabled
num_14 = Number(Slider(0, range=0..100))  # disabled
num_15 = Number(Slider(0, range=-3.1415..3.1415))  # disabled
number_slider = Slider(5, range=5..50)  # disabled
p = GhPythonScript()  # -> plane; disabled
# ---------- p: Python ----------
import rhinoscriptsyntax as rs
from compas.geometry import Point
from compas.geometry import Vector
from compas.geometry import Frame
from compas.geometry import Rotation
import math

J6_OFFSET = -math.pi/4 #panda hand

# unit in MM and rad
plane = rs.CreatePlane([550,8,200],[1,0,0],[0,1,0])
#
#  
#f_plane = Frame(plane.Origin,plane.XAxis,plane.YAxis)    
#R =Rotation.from_axis_angle_vector(f_plane.axis_angle_vector)
#r_j6_offset = Rotation.from_axis_and_angle([0,0,1],J6_OFFSET)       
#f_plane = f_plane.transformed(R*r_j6_offset)    
#
#plane = rs.CreatePlane(plane.Origin,f_plane.xaxis[:],f_plane.yaxis[:])

print(plane)
# ---------- end p ----------
p_2 = GhPythonScript()  # -> plane; disabled
# ---------- p_2: Python ----------
import rhinoscriptsyntax as rs
# unit in MM and rad
plane = rs.CreatePlane([550,8,500],[1,0,0],[0,1,0])
# ---------- end p_2 ----------
python_3 = GhPythonScript(x=num_11, y=num_14, z=num_12, rx=num_13, ry=num_15, rz=num_10)  # -> reaction; disabled
# ---------- python_3: Python ----------
__author__ = "bmade"
__version__ = "2024.03.25"

from System import Array

reaction = Array[float]([x,y,z,rx,ry,rz])
# ---------- end python_3 ----------
button = Button()  # disabled
move_reaction = GhPythonScript(
    ros_client=ros.ros_client,
    start_plane=p_2,
    target_plane=p,
    max_force=number_slider,
    reaction_vector=python_3,
    execute=button)  # -> success, has_fired; inputs reaction_vector: list; disabled
# ---------- move_reaction: Python ----------
__author__ = "Bowie Wong"
__version__ = "2024.03.25"
import rhinoscriptsyntax as rs
from compas.geometry import Point
from compas.geometry import Vector
from compas.geometry import Frame
from compas.geometry import Rotation
import math
import time
import roslibpy
from roslibpy import Service

J6_OFFSET = -math.pi/4 #panda hand

def apply_panda_hand_offset(plane):
    f_original = Frame(plane.Origin,plane.XAxis,plane.YAxis)
    f_tmp = Frame([0,0,0],[1,0,0],[0,1,0])
    
    R =Rotation.from_axis_angle_vector(f_original.axis_angle_vector)
    r_j6_offset = Rotation.from_axis_and_angle([0,0,1],J6_OFFSET)
    
    f_tmp = f_tmp.transformed(R*r_j6_offset)
    
    return Frame(f_original.point,f_tmp.xaxis,f_tmp.yaxis)


def pack_ros_msg(start_plane_,target_plane_,max_force,reaction_tx,reaction_rx):
    sp_rx,sp_ry,sp_rz = start_plane_.euler_angles(static=False,axes='xyz')
    sp_x,sp_y,sp_z = start_plane_.point    
    
    tp_rx,tp_ry,tp_rz = target_plane_.euler_angles(static=False,axes='xyz')
    tp_x,tp_y,tp_z = target_plane_.point   

    
    return dict(
        start_plane = {
            'x' : sp_x / 1000,
            'y' : sp_y / 1000,
            'z' : sp_z / 1000,
            'rx' : sp_rx,
            'ry' : sp_ry,
            'rz' : sp_rz
        },
        target_plane = {
            'x' : tp_x / 1000,
            'y' : tp_y / 1000,
            'z' : tp_z / 1000,
            'rx' : tp_rx,
            'ry' : tp_ry,
            'rz' : tp_rz
        },
        max_force = max_force,
        reaction_vector = {
            'x' : reaction_tx[0] / 1000,
            'y' : reaction_tx[1] / 1000,
            'z' : reaction_tx[2] / 1000,
            'rx' : reaction_rx[0],
            'ry' : reaction_rx[1],
            'rz' : reaction_rx[2]
        }
    )
    
    
if start_plane:
    start_plane_aligned = apply_panda_hand_offset(start_plane)
    
if target_plane:
    target_plane_aligned = apply_panda_hand_offset(target_plane) 

if reaction_vector:

    f_reaction = Frame(reaction_vector[0:3],[1,0,0],[0,1,0])
    # Use the original frame to compute the new point instead of aligned one
    f_target_plane = Frame([0,0,0],target_plane.XAxis,target_plane.YAxis)
    R = Rotation.from_axis_angle_vector(f_target_plane.axis_angle_vector)    
    reaction_tx = f_reaction.transformed(R).point   
    
    reaction_tx = reaction_tx + target_plane.Origin
      
    f_rotation = Frame([0,0,0],target_plane_aligned.xaxis[:],target_plane_aligned.yaxis[:])
    
    Rx = Rotation.from_axis_and_angle([1,0,0],reaction_vector[3])
    Ry = Rotation.from_axis_and_angle([0,1,0],reaction_vector[4])
    Rz = Rotation.from_axis_and_angle([0,0,1],reaction_vector[5])    
    
    
    f_rotation = f_rotation.transformed(Rx*Ry*Rz)
    reaction_rx = f_rotation.euler_angles(static=True,axes='xyz')
    
    print(reaction_rx)

# check all input are given:
if execute and (start_plane is not None) and (target_plane is not None) and (max_force is not None) and (reaction_vector is not None):        
    print("preparing request")
    service = roslibpy.Service(ros_client, '/robot/move_reaction', 'franka_compas_interface/MoveReaction')
#    request = roslibpy.ServiceRequest(frame_to_ros_msg(target_plane_aligned))
    
    request = roslibpy.ServiceRequest(pack_ros_msg(start_plane_aligned, target_plane_aligned, max_force, reaction_tx,reaction_rx))
    
    
    print('Calling service...')
    res = service.call(request)
    print('Service response: {}'.format(res))
    
    success = res['success']
    has_fired = res['has_fired']
# ---------- end move_reaction ----------

# ----
# Example of listening the robot state
# 
# Reference:
# https://frankaemika.github.io/libfranka/structfranka_1_1RobotState.html
# 
# Notes:
# f_t_ne, ne_t_ee, o_dp_ee_d, joint_contact, conrol_command_success_rate
# are not available as they are not compatiable with the current frankx  version
frankastateparser = GhPythonScript(franka_state=subscribe.last_msg)  # -> o_t_ee, o_t_ee_d, f_t_ee, ee_t_k, m_ee, i_ee, f_x_cee, m_load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
# ---------- frankastateparser: Python ----------
__author__ = "Bowie Wong"
__version__ = "2024.03.19"

if franka_state != None:
    o_t_ee = franka_state.o_t_ee
    o_t_ee_d = franka_state.o_t_ee_d
    f_t_ee = franka_state.f_t_ee
    ee_t_k = franka_state.ee_t_k
    m_ee = franka_state.m_ee
    i_ee = franka_state.i_ee
    f_x_cee = franka_state.f_x_cee
    m_load = franka_state.m_load
    f_x_cload = franka_state.f_x_cload
    m_total = franka_state.m_load
    i_total = franka_state.i_total
    f_x_ctotal = franka_state.f_x_ctotal
    elbow = franka_state.elbow
    elbow_d = franka_state.elbow_d
    elbow_c = franka_state.elbow_c
    delbow_c = franka_state.delbow_c
    ddelbow_c = franka_state.ddelbow_c
    tau_j = franka_state.tau_j
    tau_j_d = franka_state.tau_j_d
    dtau_j = franka_state.dtau_j
    q = franka_state.q
    q_d = franka_state.q_d
    dq = franka_state.dq
    dq_d = franka_state.dq_d
    ddq_d = franka_state.ddq_d
    cartesian_contact = franka_state.cartesian_contact
    joint_collision = franka_state.joint_collision
    cartesian_collision = franka_state.cartesian_collision
    tau_ext_hat_filtered = franka_state.tau_ext_hat_filtered
    o_f_ext_hat_k = franka_state.o_f_ext_hat_k
    k_f_ext_hat_k =franka_state.k_f_ext_hat_k
    o_t_ee_c = franka_state.o_t_ee_c
    o_dp_ee_c = franka_state.o_dp_ee_c
    o_ddp_ee_c = franka_state.o_ddp_ee_c
    theta = franka_state.theta
    dtheta = franka_state.dtheta
# ---------- end frankastateparser ----------
panel_4 = Panel(frankastateparser.q)

# ----
# Move Linear Example
# You can replace this with a Plane in GH ---->
python_4 = GhPythonScript()  # -> plane; same code as p_2
move_to = Button()
movelinear = GhPythonScript(ros_client=ros.ros_client, target_plane=python_4, execute_motion=move_to)
# ---------- movelinear: Python ----------
__author__ = "Bowie Wong"
__version__ = "2024.03.19"
import rhinoscriptsyntax as rs
from compas.geometry import Point
from compas.geometry import Vector
from compas.geometry import Frame
from compas.geometry import Rotation
import math
import time
import roslibpy
from roslibpy import Service

J6_OFFSET = -math.pi/4 #panda hand

def apply_panda_hand_offset(plane):
    f_original = Frame(plane.Origin,plane.XAxis,plane.YAxis)
    f_tmp = Frame([0,0,0],[1,0,0],[0,1,0])
    
    R =Rotation.from_axis_angle_vector(f_original.axis_angle_vector)
    r_j6_offset = Rotation.from_axis_and_angle([0,0,1],J6_OFFSET)
    
    f_tmp = f_tmp.transformed(R*r_j6_offset)
    
    return Frame(f_original.point,f_tmp.xaxis,f_tmp.yaxis)


def frame_to_move_linear_msg(f):
    rx,ry,rz = f.euler_angles(static=False,axes='xyz')
    x,y,z = f.point    
    return dict(x=x/1000,y=y/1000,z=z/1000,rx=rx,ry=ry,rz=rz,speed=0.1)
    
    

target_plane_aligned = apply_panda_hand_offset(target_plane) 


if execute_motion:        
    service = roslibpy.Service(ros_client, '/robot/move_linear', 'franka_compas_interface/MoveLinear')
    request = roslibpy.ServiceRequest(frame_to_move_linear_msg(target_plane_aligned))
    print('Calling service...')
    result = service.call(request)
    print('Service response: {}'.format(result))

    result = True
# ---------- end movelinear ----------

# ----
# Home Robot:
# 1/ Reset all error
# 2/ Move to home pos
# 3/ Open gripper
move_to_2 = Button()
homerobot = GhPythonScript(ros_client=ros.ros_client, execute_motion=move_to_2)
# ---------- homerobot: Python ----------
__author__ = "Bowie Wong"
__version__ = "2024.03.19"
import rhinoscriptsyntax as rs
from compas.geometry import Point
from compas.geometry import Vector
from compas.geometry import Frame
from compas.geometry import Rotation
import math
import time
import roslibpy
from roslibpy import Service



if execute_motion:        
    service = roslibpy.Service(ros_client, '/robot/home', 'franka_compas_interface/HomeRobot')
    request = roslibpy.ServiceRequest()
    print('Calling service...')
    result = service.call(request)
    print('Service response: {}'.format(result))

    result = True
# ---------- end homerobot ----------

panel_5 = Panel(move_reaction.success)  # disabled
panel_6 = Panel(move_reaction.has_fired)  # disabled

# ----
# Close Gripper using the
# clamp function from the gripper.
# 
# Speed: m/s
# Force: N
number_slider_2 = Slider(42.3, range=1..70)
clamp = Button()
close_gripper = GhPythonScript(ros_client=ros.ros_client, gripper_speed=Slider(0.5, range=0..1), gripper_force=number_slider_2, execute=clamp)
# ---------- close_gripper: Python ----------
__author__ = "Bowie Wong"
__version__ = "2024.03.20"

import roslibpy
from roslibpy import Service


if execute:    
    
    service = roslibpy.Service(ros_client, '/robot/close_gripper', 'franka_compas_interface/CloseGripper')
    request = roslibpy.ServiceRequest(dict(gripper_speed=gripper_speed,gripper_force=gripper_force))
    print('Calling service...')
    result = service.call(request)
    print('Service response: {}'.format(result))

    a = result['success']
    
    result = True
# ---------- end close_gripper ----------

# ----
# Gripper Release
# distance: mm
number_slider_3 = Slider(83, range=0..83)
release = Button()
close_gripper_2 = GhPythonScript(ros_client=ros.ros_client, distance=number_slider_3, execute=release)
# ---------- close_gripper_2: Python ----------
__author__ = "Bowie Wong"
__version__ = "2024.03.20"

import roslibpy
from roslibpy import Service


if execute:    
    
    service = roslibpy.Service(ros_client, '/robot/open_gripper', 'franka_compas_interface/OpenGripper')
    request = roslibpy.ServiceRequest(dict(distance=distance/1000))
    print('Calling service...')
    result = service.call(request)
    print('Service response: {}'.format(result))

    a = result['success']
    
    result = True
# ---------- end close_gripper_2 ----------

# ----
# 5 / Gripper Release
number_slider_4 = Slider(83, range=0..83)
release_2 = Button()
close_gripper_3 = GhPythonScript(ros_client=ros.ros_client, distance=number_slider_4, execute=release_2)  # same code as close_gripper_2

# ----
# 2 / Close Gripper
number_slider_5 = Slider(0.5, range=0..1)
clamp_2 = Button()
close_gripper_4 = GhPythonScript(ros_client=ros.ros_client, gripper_speed=number_slider_5, gripper_force=Slider(70, range=1..70), execute=clamp_2)  # same code as close_gripper

# ----
# Display the Robot Model
list = RobotsLibrary(
    {"Franka Emika Panda", "Bartlett-IRB120", "Bartlett-IRB1600", "Bartlett-KR6", "Bartlett-KR60-A", "Bartlett-KR60-B", "Bartlett-KR500", "Bartlett-KR60 on track", "Bartlett-UR10", "Bartlett-KR60", "Bartlett-TX200", "Bartlett-TX200L", "Bartlett-RX160", "Bartlett-RX160L"}, selected="Franka Emika Panda",
    Type=0)
deg = Degrees(Radians=panel_4)
loadrobot = LoadRobotSystem(Name=list, Base=PlaneXY(0, 0, 0))
degtorad = DegreesToRadians(Degrees=deg, RobotSystem=loadrobot, MechanicalGroup=0)
target = CreateTarget(Joints=degtorad, IsCartesian=False)
K = Kinematics(RobotSystem=loadrobot, Target=target, DisplayGeometry=True)  # -> Meshes, Joints, Planes, Errors
mesh = Mesh(K.Meshes)

# ----
# 4/ Put it back
python_5 = GhPythonScript()  # -> plane
# ---------- python_5: Python ----------
import rhinoscriptsyntax as rs
# unit in MM and rad
plane = rs.CreatePlane([555,-117,200],[1,0,0],[0,1,0])
# ---------- end python_5 ----------
move_to_3 = Button()
movelinear_2 = GhPythonScript(ros_client=ros.ros_client, target_plane=python_5, execute_motion=move_to_3)  # same code as movelinear

# ----
# 3/ Move up
move_to_4 = Button()
python_6 = GhPythonScript()  # -> plane
# ---------- python_6: Python ----------
import rhinoscriptsyntax as rs
# unit in MM and rad
plane = rs.CreatePlane([555,-117,300],[1,0,0],[0,1,0])
# ---------- end python_6 ----------
movelinear_3 = GhPythonScript(ros_client=ros.ros_client, target_plane=python_6, execute_motion=move_to_4)  # same code as movelinear

# ----
# 1/ Move to pick up station
python_7 = GhPythonScript()  # -> plane; same code as python_5
move_to_5 = Button()
movelinear_4 = GhPythonScript(ros_client=ros.ros_client, target_plane=python_7, execute_motion=move_to_5)  # same code as movelinear

# ----
# 6/ Home the robot
move_to_6 = Button()
homerobot_2 = GhPythonScript(ros_client=ros.ros_client, execute_motion=move_to_6)  # same code as homerobot

merge = Merge()
python_8 = GhPythonScript()  # -> plane; same code as python_5
xy = XYPlane(Origin=Point(0, 0, 0))
Z = UnitZ(Factor=Slider(125, range=0..1000))
pflip = FlipPlane(Plane=python_8, ReverseX=False, ReverseY=False, SwapAxes=True)
move = Move(Geometry=xy, Motion=Z)  # -> Geometry, Transform
Z_2 = UnitZ(Factor=Slider(100, range=0..100))
python_9 = GhPythonScript()  # -> plane; same code as python_5
move_2 = Move(Geometry=pflip, Motion=Z_2)  # -> Geometry, Transform
pln = Plane(move.Geometry)

# ---- group: TCP
mesh_2 = Mesh(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)
# Tool
tool = CreateTool(Name="Gripper", TCP=pln, Weight="1.75", Mesh=mesh_2)  # -> Tool, TCP
tool_2 = ToolParameter(tool.Tool)

# ----
pflip_2 = FlipPlane(Plane=python_9, ReverseX=False, ReverseY=False, SwapAxes=True)
merge_2 = Merge(
    Data1=Slider(0, range=-180..180),
    Data2=Slider(0, range=-180..180),
    Data3=Slider(0, range=-180..180),
    Data4=Slider(0, range=-180..180),
    Data5=Slider(0, range=-180..180),
    Data6=Slider(-90, range=-180..180))
list_2 = ValueList({"Joint", "Linear"}, selected="Linear")
list_3 = ValueList({"Joint", "Linear"}, selected="Linear")
list_4 = ValueList({"Joint", "Linear"}, selected="Linear")
target_2 = CreateTarget(Plane=pflip, Motion=list_2, Tool=tool_2, IsCartesian=True)
closegripper = CloseGripper(Speed=Slider(0.5, range=0..1), Force=Slider(70, range=1..70))
target_3 = CreateTarget(Plane=move_2.Geometry, Motion=list_4, Tool=tool_2, IsCartesian=True)
opengripper = OpenGripper(Width=Slider(83, range=0..83))
toreactionvector = ToReactionVector(Reaction=merge_2)
target_4 = CreateTarget(
    Plane=pflip_2,
    Motion=list_3,
    Tool=tool_2,
    MaxForce=Slider(10, range=0..10),
    ReactionVector=toreactionvector,
    IsCartesian=True)
list_5 = RobotsLibrary(
    {"Franka Emika Panda", "Bartlett-IRB120", "Bartlett-IRB1600", "Bartlett-KR6", "Bartlett-KR60-A", "Bartlett-KR60-B", "Bartlett-KR500", "Bartlett-KR60 on track", "Bartlett-UR10", "Bartlett-KR60", "Bartlett-TX200", "Bartlett-TX200L", "Bartlett-RX160", "Bartlett-RX160L"}, selected="Franka Emika Panda",
    Type=0)
loadrobot_2 = LoadRobotSystem(Name=list_5, Base=PlaneXY(0, 0, 0))

# ----
# Home
number_slider_6 = Slider(0, range=-180..180)
merge_3 = Merge(
    Data1=number_slider_6,
    Data2=Slider(0, range=-180..180),
    Data3=Slider(0, range=-180..180),
    Data4=Slider(-90, range=-180..180),
    Data5=Slider(0, range=-180..180),
    Data6=Slider(90, range=-180..180),
    Data7=Slider(0, range=-180..180))
degtorad_2 = DegreesToRadians(Degrees=merge_3, RobotSystem=loadrobot_2, MechanicalGroup=0)
tool_3 = ToolParameter(tool_2)
target_5 = CreateTarget(Joints=degtorad_2, Tool=tool_3, IsCartesian=False)

merge_4 = Merge(
    Data1=flatten(target_5),
    Data2=flatten(target_2),
    Data3=flatten(closegripper),
    Data4=flatten(target_3),
    Data5=flatten(target_4),
    Data6=flatten(opengripper),
    Data7=flatten(target_3),
    Data8=flatten(target_5))
to_real_robot = GhPythonScript(ros_client=ros.ros_client, robot_program=merge_4, execute_motion=Button())  # -> out, a; inputs robot_program: list
# ---------- to_real_robot: Python ----------
__author__ = "bmade"
__version__ = "2024.03.26"

import rhinoscriptsyntax as rs
import roslibpy
from roslibpy import Service
from compas.geometry import Point
from compas.geometry import Vector
from compas.geometry import Frame
from compas.geometry import Rotation
import math


J6_OFFSET = -math.pi/4 #panda hand

def apply_panda_hand_offset(plane):
    f_original = Frame(plane.Origin,plane.XAxis,plane.YAxis)
    f_tmp = Frame([0,0,0],[1,0,0],[0,1,0])
    
    R =Rotation.from_axis_angle_vector(f_original.axis_angle_vector)
    r_j6_offset = Rotation.from_axis_and_angle([0,0,1],J6_OFFSET)
    
    f_tmp = f_tmp.transformed(R*r_j6_offset)
    
    return Frame(f_original.point,f_tmp.xaxis,f_tmp.yaxis)



def pack_move_linear_with_reaction_ros_msg(target_plane_,max_force,reaction_tx,reaction_rx):

    tp_rx,tp_ry,tp_rz = target_plane_.euler_angles(static=False,axes='xyz')
    tp_x,tp_y,tp_z = target_plane_.point   

    
    return dict(      
        target_plane = {
            'x' : tp_x / 1000,
            'y' : tp_y / 1000,
            'z' : tp_z / 1000,
            'rx' : tp_rx,
            'ry' : tp_ry,
            'rz' : tp_rz
        },
        max_force = max_force,
        reaction_vector = {
            'x' : reaction_tx[0] / 1000,
            'y' : reaction_tx[1] / 1000,
            'z' : reaction_tx[2] / 1000,
            'rx' : reaction_rx[0],
            'ry' : reaction_rx[1],
            'rz' : reaction_rx[2]
        }
    )

def frame_to_move_linear_msg(f):
    rx,ry,rz = f.euler_angles(static=False,axes='xyz')
    x,y,z = f.point    
    return dict(x=x/1000,y=y/1000,z=z/1000,rx=rx,ry=ry,rz=rz,speed=0.1)
    


move_jnt_service = roslibpy.Service(ros_client, '/robot/move_joint', 'franka_compas_interface/MoveJoint')
move_linear_service = roslibpy.Service(ros_client, '/robot/move_linear', 'franka_compas_interface/MoveLinear')
close_gripper_service = roslibpy.Service(ros_client, '/robot/close_gripper', 'franka_compas_interface/CloseGripper')
open_grippper_service = roslibpy.Service(ros_client, '/robot/open_gripper', 'franka_compas_interface/OpenGripper')
move_linear_with_reaction_service = roslibpy.Service(ros_client, '/robot/move_reaction', 'franka_compas_interface/MoveReaction')
    
if execute_motion:
    for cmd in robot_program:
        cmd_type = type(cmd).__name__
        if cmd_type == "JointTarget":            
            # Cast rs.Array to python list
            #Warning: roslibpy.ServiceRequest(dict(joint_positions=cmd.Joints[:])) 
            # or something similar will crash the Rhino
            pos = cmd.Joints            
            pos = [pos[0],pos[1],pos[2],pos[3],pos[4],pos[5],pos[6]]                       
            request = roslibpy.ServiceRequest(dict(joint_positions=pos))            
            result = move_jnt_service.call(request)                        
        elif cmd_type == "CartesianTarget": 
        
            target_plane = cmd.Plane
            target_plane.Flip()          
            target_plane_aligned = apply_panda_hand_offset(target_plane)
            
            if ((cmd.MaxForce is not None) and (cmd.ReactionVector is not None)):
                # move linear with reaction
                reaction_vector = cmd.ReactionVector
                f_reaction = Frame([reaction_vector[0],reaction_vector[1],reaction_vector[2]],[1,0,0],[0,1,0])
                f_target_plane = Frame([0,0,0],target_plane.XAxis,target_plane.YAxis)
                R = Rotation.from_axis_angle_vector(f_target_plane.axis_angle_vector)    
                reaction_tx = f_reaction.transformed(R).point       
                reaction_tx = reaction_tx + target_plane.Origin                  
                f_rotation = Frame([0,0,0],target_plane_aligned.xaxis[:],target_plane_aligned.yaxis[:])                
                Rx = Rotation.from_axis_and_angle([1,0,0],math.radians(reaction_vector[3]))
                Ry = Rotation.from_axis_and_angle([0,1,0],math.radians(reaction_vector[4]))
                Rz = Rotation.from_axis_and_angle([0,0,1],math.radians(reaction_vector[5]))                    
                f_rotation = f_rotation.transformed(Rx*Ry*Rz)
                reaction_rx = f_rotation.euler_angles(static=True,axes='xyz')
                request = roslibpy.ServiceRequest(pack_move_linear_with_reaction_ros_msg(target_plane_aligned, cmd.MaxForce, reaction_tx,reaction_rx))
                res = move_linear_with_reaction_service.call(request)
            else:
                #normal move linear                
                #https://developer.rhino3d.com/api/rhinocommon/rhino.geometry.plane/flip                
                request = roslibpy.ServiceRequest(frame_to_move_linear_msg(target_plane_aligned))
                result = move_linear_service.call(request)                        
        elif cmd_type == "OpenGripper":
            gripper_width = cmd.Width
            request = roslibpy.ServiceRequest(dict(distance=gripper_width/1000))
            open_grippper_service.call(request)
        elif cmd_type == "CloseGripper":
            gripper_speed = cmd.Speed
            gripper_force = cmd.Force            
            request = roslibpy.ServiceRequest(dict(gripper_speed=gripper_speed,gripper_force=gripper_force))
            close_gripper_service.call(request)
# ---------- end to_real_robot ----------
program = CreateProgram(Name="DefaultProgram", RobotSystem=loadrobot_2, Targets=merge_4, StepSize=1)  # -> Program, Code, Duration, Warnings, Errors
sim = ProgramSimulation(Program=program.Program, Time=Slider(1, range=0..1), Normalized=True)  # -> SystemMeshes, JointRotations, Plane, Index, Time, Program, Errors

# ---- group: Home
target_6 = TargetParameter()
